% Simulink data dictionary data2_dic.sldd

Ie = Simulink.Parameter(1)
Iv = Simulink.Parameter(5)
be = Simulink.Parameter(2)
bv = Simulink.Parameter(1)
Uk = Simulink.Parameter(1)
Us = Simulink.Parameter(1.5)
R = Simulink.Parameter(1)

Tn = Simulink.Parameter([1 2
 2 2
 3 2
 4 2
 5 2
 6 0
 7 0
 8 0
 9 0
 10 0])

Fn = Simulink.Parameter([0 0
 1 0.8
 2 1.6
 3 1.6
 4 1.6
 5 1.6
 6 0.8
 7 0
 8 0
 9 0
 10 0])